# Grasshopper definition 0_cactus_geometry_template copy.gh (Grasshopper 1.0.7)
# plug-ins: Pufferfish, Pancake

# Host: The host needs to be a solid Brep. The host name is used thorughout the simulation. It should be a four digit number beginning from 1001 (1000 is reserved for the template host).
number_slider = Slider(1111, range=1000..9999)
pipeline = GeometryPipeline(
    GroupByLayer=False,
    GroupByType=False,
    IncludeHidden=True,
    IncludeLocked=True,
    LayerFilter="input*host",
    NameFilter="*",
    SublayerFiltering=True,
    TypeFilter=1073741848)

# ---- group: Opaque Context
pipeline_2 = GeometryPipeline(
    GroupByLayer=False,
    GroupByType=False,
    IncludeHidden=True,
    IncludeLocked=True,
    LayerFilter="input*opaque_context",
    NameFilter="*",
    SublayerFiltering=True,
    TypeFilter=1073741848)
panel = Panel("output_opaque_context")

# ---- group: Seasonal Vegetation
pipeline_3 = GeometryPipeline(
    GroupByLayer=False,
    GroupByType=False,
    IncludeHidden=True,
    IncludeLocked=True,
    LayerFilter="input*vegetation_seasonal",
    NameFilter="*",
    SublayerFiltering=True,
    TypeFilter=32)
number_slider_2 = Slider(5, range=0..10)
redumsh = ReduceMesh(Mesh=pipeline_3, FaceCount=20, Accuracy=number_slider_2, FaceType=0, Distort=True, Normalize=False)  # -> Reduced, CountDifference
panel_2 = Panel("output_vegetation_seasonal")

# ---- group: Constant Vegetation
pipeline_4 = GeometryPipeline(
    GroupByLayer=False,
    GroupByType=False,
    IncludeHidden=True,
    IncludeLocked=True,
    LayerFilter="input*vegetation_constant",
    NameFilter="*",
    SublayerFiltering=True,
    TypeFilter=32)
redumsh_2 = ReduceMesh(Mesh=pipeline_4, FaceCount=20, Accuracy=number_slider_2, FaceType=0, Distort=True, Normalize=False)  # -> Reduced, CountDifference
panel_3 = Panel("output_vegetation_constant")

# ----
# Terrain: Read in terrain surface and flip any subfaces that are not pointing towards the sky.
pipeline_5 = GeometryPipeline(
    GroupByLayer=False,
    GroupByType=False,
    IncludeHidden=True,
    IncludeLocked=True,
    LayerFilter="*terrain",
    NameFilter="*",
    SublayerFiltering=True,
    TypeFilter=1073741848)
debrep = DeconstructBrep(Brep=pipeline_5)  # -> Faces, Edges, Vertices
area = Area(Geometry=debrep.Faces)  # -> Area, Centroid
evalsrf = EvaluateSurface(Surface=debrep.Faces, Point=area.Centroid)  # -> Point, Normal, UDirection, VDirection, Frame
devec = DeconstructVector(Vector=evalsrf.Normal)  # -> XComponent, YComponent, ZComponent
larger = LargerThan(FirstNumber=devec.ZComponent, SecondNumber=Slider(0, range=0..100))  # -> LargerThan, OrEqualTo
dispatch = Dispatch(List=debrep.Faces, DispatchPattern=larger.LargerThan)  # -> ListA, ListB
flip = Flip(Surface=dispatch.ListB)  # -> Surface, Result
merge = Merge(Data1=dispatch.ListA, Data2=flip.Surface)

# ---- group: Controls
# Surface Design: For non integrated arrays a base surface needs to be created for the radiance simulations. This allows the panelizer a host surface to build multiple type of module convifgurations on that share a common irradiance map. Setting the depth parameters is therefore very important. It is recommended that the depth be set to at leas thte largest posisble module being tested. Other parameters:
# Useful Area - how much of the surface can you use. Note this parameter exists in the panelizer too.
# Primary tilt - the primary angle from the surface that the first set of the array is set to.
# Primary depth - the depth of the first set of the array
# Secondary tilt - while uncommon you can set the other side of the array to ahve a different angle.
# Secondary depth - If for some reason the second set of the array might be using a different module type you can set a different value here
# Worst angle - this is the worst profile angle of the sun for the occlusion of the primary surface.
# Primary Azimuth - the direction that the primary portion of the array will face. Note that this is not cardinal, but rrather a clockwise angle from the Y-vector of the surface. The possible range is 0 to 90 and only accepts integers.
primary_azimuth_max_90 = Slider(45, range=0..90)
number_slider_3 = Slider(10, range=0..100)
worst_angle = Slider(8, range=0..100)
number_slider_4 = Slider(1.1, range=0..2)
number_slider_5 = Slider(10, range=0..100)
number_slider_6 = Slider(1.1, range=0..2)
useful_area = Slider(0.9, range=0..1)

# ---- group: Extra Surfaces
srf = Surface()

# ----
calculate_row_distance = GhPythonScript(
    primary_tilt=number_slider_5,
    primary_depth=number_slider_4,
    secondary_tilt=number_slider_3,
    secondary_depth=number_slider_6,
    worst_angle=worst_angle)  # -> out, d_contour, x, x_p, y_p, y_s
# ---------- calculate_row_distance: Python ----------
__author__ = "jmccarty"

from math import tan, cos, sin, radians

theta_p = radians(primary_tilt)
theta_s = radians(secondary_tilt)
theta_w = radians(worst_angle)

x_p = cos(theta_p) * primary_depth
y_p = sin(theta_p) * primary_depth
y_s = sin(theta_s) * secondary_depth
y = max(y_p, y_s)

x_s = cos(theta_s) * secondary_depth
x = x_p + x_s

sx_s = y / tan(theta_w)
s = max(0, sx_s - x_s)

d_contour = round(x_p + x_s + s,3)
x = round(x,3)
x_p = round(x_p,3)
y_p = round(y_p,3)
y_s = round(y_s,3)
# ---------- end calculate_row_distance ----------

# ----
# Geometry Builder: The geometry builder is in an early form here. It is intended to help you prepare basic geometry for the panelizer and for writing the Radiance model. A few global rules:
# 1. Keep all objects as close to World (0,0,0) as possible.
# 2. Do not allow any objects to exist anywhere below (0,0,0).
# 3. North is the Y-vector +1
project_config_file = FilePath("/Users/jmccarty/Data/230203_ecos_bipv_model/journal_paper/cactus_framework_study/cactus_framework_study.config")
read_workbench_config = GhPythonScript(config_file=project_config_file)  # -> out, keys, values
# ---------- read_workbench_config: Python ----------
"""Read the config file for a workbench project."""

__author__ = "jmccarty"



with open(config_file) as fp:
    config = fp.readlines()
    
config = [c.replace("\n","").replace(r"[","").replace(r"]","") for c in config]

management = {}

for c in config:
    if c == 'management':
        pass
    elif c == 'analysis':
        break
    elif c == "":
        pass
    else:
        #print(c)
        key = c.split(" = ")[0]
        #print(key)
        value = c.split(" = ")[1]
        #print(value)
        management[key] = value

keys = list(management.keys())
values = list(management.values())
# ---------- end read_workbench_config ----------
panel_4 = Panel("""parent_dir
project_name
host_name
scenario_name""")
get_config_value = GhPythonScript(keys=read_workbench_config.keys, values=read_workbench_config.values, search_key=panel_4)  # -> out, out_value; inputs keys: list, values: list
# ---------- get_config_value: Python ----------
__author__ = "jmccarty"

import rhinoscriptsyntax as rs

config = dict(zip(keys,values))

out_value = config[search_key]
# ---------- end get_config_value ----------
list = ValueList({"project_data", "raw_host_file", "latitude", "host_name", "exclude_surfaces", "base_epw", "longitude", "timezone", "elevation", "parent_dir", "project_name", "utc", "scenario_name", "tmy_name"}, selected="parent_dir")  # disabled
name_geometry_file = GhPythonScript(config_keys=panel_4, config_values=get_config_value.out_value)  # -> out, out_dir, out_name, out_file; inputs config_keys: list, config_values: list
# ---------- name_geometry_file: Python ----------
"""Creates the file path to save the 
    geometry file out of the template"""

__author__ = "jmccarty"

import os 
 

config_inputs = dict(zip(config_keys,config_values))

parent_dir = config_inputs['parent_dir']
project_name = config_inputs['project_name']
host_name = config_inputs['host_name']
scenario_name = config_inputs['scenario_name']

out_dir = os.path.join(parent_dir, project_name, "inputs", "hosts", host_name, scenario_name, "geometry")
out_name = "1_geometry.3dm"

out_file = os.path.join(out_dir,out_name)
# ---------- end name_geometry_file ----------
write_overwrite_new_geometry_file = BooleanToggle(False)

# ----
# Surface Obstructions: Windows, balconies, and other objects that are attached to the Host and would prevent a PV module from being installed. It is best to consider these interruptions as larger than they actually are. For instance the balcony provide considerablde shade below and beside it. Oversizing it will prvent modules from being installed in that area.
pipeline_6 = GeometryPipeline(
    GroupByLayer=False,
    GroupByType=False,
    IncludeHidden=True,
    IncludeLocked=True,
    LayerFilter="input*surface_obstructions",
    NameFilter="*",
    SublayerFiltering=True,
    TypeFilter=1073741848)
pipeline_7 = GeometryPipeline(
    GroupByLayer=False,
    GroupByType=False,
    IncludeHidden=True,
    IncludeLocked=True,
    LayerFilter="input*balcony",
    NameFilter="*",
    SublayerFiltering=True,
    TypeFilter=1073741848)
pipeline_8 = GeometryPipeline(
    GroupByLayer=False,
    GroupByType=False,
    IncludeHidden=True,
    IncludeLocked=True,
    LayerFilter="input*windows",
    NameFilter="*",
    SublayerFiltering=True,
    TypeFilter=1073741848)
host = Brep(pipeline)
host_2 = Brep(pipeline)
host_3 = Brep(pipeline)
debrep_2 = DeconstructBrep(Brep=pipeline_7)  # -> Faces, Edges, Vertices
debrep_3 = DeconstructBrep(Brep=pipeline_6)  # -> Faces, Edges, Vertices
area_2 = Area(Geometry=debrep_2.Faces)  # -> Area, Centroid
area_3 = Area(Geometry=debrep_3.Faces)  # -> Area, Centroid
brepsinc = PointInBreps(Brep=host, Point=area_2.Centroid, Strict=False)  # -> Inside, Index
brepsinc_2 = PointInBreps(Brep=host_3, Point=area_3.Centroid, Strict=False)  # -> Inside, Index
dispatch_2 = Dispatch(List=debrep_2.Faces, DispatchPattern=brepsinc.Inside)  # -> ListA, ListB
dispatch_3 = Dispatch(List=debrep_3.Faces, DispatchPattern=brepsinc_2.Inside)  # -> ListA, ListB

# ---- group: Ensure normals face out
area_4 = Area(Geometry=pipeline_8)  # -> Area, Centroid
evalsrf_2 = EvaluateSurface(Surface=pipeline_8, Point=area_4.Centroid)  # -> Point, Normal, UDirection, VDirection, Frame
line = LineSDL(Start=area_4.Centroid, Direction=evalsrf_2.Normal, Length=Slider(0.01, range=0..0.01))
curvepoint = PointOnCurve(line, parameter=1)
brepinc = PointInBrep(Brep=host_2, Point=curvepoint, Strict=False)
dispatch_4 = Dispatch(List=pipeline_8, DispatchPattern=brepinc)  # -> ListA, ListB
flip_2 = Flip(Surface=dispatch_4.ListA)  # -> Surface, Result
merge_2 = Merge(Data1=flip_2.Surface, Data2=dispatch_4.ListB)

# ----
merge_3 = Merge(Data1=merge_2, Data2=dispatch_2.ListA, Data3=dispatch_3.ListA)

flatten = FlattenTree(Tree=merge_3, Path="{0}")
brep = Brep(flatten)

host_4 = Brep(pipeline)
merge_4 = Merge(Data1=srf, Data2=host_4)
debrep_4 = DeconstructBrep(Brep=merge_4)  # -> simplify(graft(Faces)), Edges, Vertices
area_5 = Area(Geometry=flatten)  # -> Area, Centroid

# ---- group: Flip Normals
area_6 = Area(Geometry=debrep_4.Faces)  # -> Area, Centroid
evalsrf_3 = EvaluateSurface(Surface=debrep_4.Faces, Point=area_6.Centroid)  # -> Point, Normal, UDirection, VDirection, Frame
devec_2 = DeconstructVector(Vector=evalsrf_3.Normal)  # -> XComponent, YComponent, ZComponent
smaller = SmallerThan(FirstNumber=devec_2.ZComponent, SecondNumber=0)  # -> SmallerThan, OrEqualTo
dispatch_5 = Dispatch(List=debrep_4.Faces, DispatchPattern=smaller.SmallerThan)  # -> ListA, ListB
flip_3 = Flip(Surface=dispatch_5.ListA)  # -> Surface, Result
merge_5 = Merge(Data1=flip_3.Surface, Data2=dispatch_5.ListB)

# ----
area_7 = Area(Geometry=merge_5)  # -> Area, Centroid
evalsrf_4 = EvaluateSurface(Surface=merge_5, Point=area_7.Centroid)  # -> Point, Normal, UDirection, VDirection, Frame
amp = Amplitude(Vector=evalsrf_4.Normal, Amplitude=Slider(0.5, range=0..1))
extr = Extrude(Base=merge_5, Direction=amp)
brepinc_2 = PointInBrep(Brep=extr, Point=area_5.Centroid, Strict=False)
dispatch_6 = Dispatch(List=flatten, DispatchPattern=brepinc_2)  # -> ListA, ListB

# ---- group: Join surfaces and split
sunion = SolidUnion(Breps=dispatch_6.ListA)
fmerge = MergeFaces(Brep=sunion)  # -> Breps, Before, After
srfsplit = SurfaceSplit(Surface=merge_5, Curves=fmerge.Breps)

# ---- group: Get surface that was trimmed based on center point analysis
area_8 = Area(Geometry=srfsplit)  # -> Area, Centroid
ln = Line(StartPoint=area_8.Centroid, EndPoint=area_7.Centroid)
len = Length(Curve=ln)
sort = SortList(Keys=len, ValuesA=srfsplit)  # -> Keys, ValuesA
item = ListItem(List=sort.ValuesA, Index=0, Wrap=True)

# ----
flatten_2 = FlattenTree(Tree=item, Path=number_slider)

# ---- group: label surfaces
# Match the labels to types fo the panleizer. Either integrated, attached, or none. Attached only works for sloped surfaces (<90˚ from horizontal).
listdexs = ListIndices(List=flatten_2)
area_9 = Area(Geometry=flatten_2)  # -> Area, Centroid
tag = TextTag(Location=area_9.Centroid, Text=listdexs, Colour=ColourSwatch(SwatchColor=RGB(255, 254, 254)))
panelizer_type = Panel("""integrated
none
none
none
none
none""")

# ---- group: We build extra surfaces for the panelizer to work on with the attached systems.
# We assume that attached arrays will follow the standard convention of a peak-valley array with a primary direction and a secondary direction that is 180˚ opposite of that. /\/\/\/\/\/\
panel_5 = Panel("attached")
mindex = MemberIndex(Set=panelizer_type, Member=panel_5)  # -> Index, Count
primary_directions_0_359_0_n_90_e = Panel("""45
180""")
item_2 = ListItem(List=flatten_2, Index=mindex.Index, Wrap=True)  # -> graft(Item)

# ---- group: These need no further operation before panelizer.
mindex_2 = MemberIndex(Set=panelizer_type, Member="integrated")  # -> Index, Count
item_3 = ListItem(List=flatten_2, Index=mindex_2.Index, Wrap=True)

# ---- group: For surfaces with holes get exterior curves
edges = BrepEdges(Brep=item_2)  # -> Naked, Interior, NonManifold
cls = Closed(Curve=edges.Naked)  # -> Closed, Periodic
dispatch_7 = Dispatch(List=edges.Naked, DispatchPattern=cls.Closed)  # -> ListA, ListB
crv = Curve(dispatch_7.ListB)
join = JoinCurves(Curves=crv, Preserve=False)
debrep_5 = DeconstructBrep(Brep=join)  # -> simplify(Faces), Edges, Vertices
area_10 = Area(Geometry=debrep_5.Faces)  # -> Area, Centroid
scale = Scale(Geometry=debrep_5.Faces, Center=area_10.Centroid, Factor=useful_area)  # -> Geometry, Transform

# ---- group: Flip Normals
area_11 = Area(Geometry=scale.Geometry)  # -> Area, Centroid
evalsrf_5 = EvaluateSurface(Surface=scale.Geometry, Point=area_11.Centroid)  # -> Point, Normal, UDirection, VDirection, Frame
devec_3 = DeconstructVector(Vector=evalsrf_5.Normal)  # -> XComponent, YComponent, ZComponent
smaller_2 = SmallerThan(FirstNumber=devec_3.ZComponent, SecondNumber=0)  # -> SmallerThan, OrEqualTo
dispatch_8 = Dispatch(List=scale.Geometry, DispatchPattern=smaller_2.SmallerThan)  # -> ListA, ListB
flip_4 = Flip(Surface=dispatch_8.ListA)  # -> Surface, Result
merge_6 = Merge(Data1=flip_4.Surface, Data2=dispatch_8.ListB)
area_12 = Area(Geometry=merge_6)  # -> Area, Centroid

# ---- group: Get Lower Left
brep_2 = Brep(merge_6)
area_13 = Area(Geometry=brep_2)  # -> Area, Centroid
evalsrf_6 = EvaluateSurface(Surface=brep_2, Point=area_13.Centroid)  # -> Point, Normal, UDirection, VDirection, Frame
vec = VectorXYZ(XComponent=Slider(0, range=0..100), YComponent=Slider(1, range=0..1), ZComponent=Slider(0, range=0..100))  # -> Vector, Length
debrep_6 = DeconstructBrep(Brep=brep_2)  # -> Faces, Edges, Vertices
trim = TrimTree(Tree=debrep_6.Vertices, Depth=1)
pdecon = Deconstruct(Point=trim)  # -> XComponent, YComponent, ZComponent
sort_2 = SortList(Keys=pdecon.ZComponent)  # -> Keys, ValuesA
cset = CreateSet(List=sort_2.Keys)  # -> Set, Map
item_4 = ListItem(List=cset.Set, Index=0, Wrap=True)
mindex_3 = MemberIndex(Set=pdecon.ZComponent, Member=item_4)  # -> Index, Count
trim_2 = TrimTree(Tree=mindex_3.Index, Depth=1)
item_5 = ListItem(List=trim, Index=trim_2, Wrap=True)
calc_angle_from_north = GhPythonScript(north_vector=vec.Vector, vector_b=evalsrf_6.Normal)  # -> out, angle; inputs north_vector: Vector3d, vector_b: Vector3d
# ---------- calc_angle_from_north: Python ----------
__author__ = "jmccarty_teach"

import rhinoscriptsyntax as rs
import math


x1 = north_vector.X
x2 = vector_b.X
y1 = north_vector.Y
y2 = vector_b.Y

a = (x1,y1)
b = (x2,y2)

ang1 = math.atan2(*a[::-1])
ang2 = math.atan2(*b[::-1])

angle = math.degrees((ang1 - ang2) % (2 * math.pi))
# ---------- end calc_angle_from_north ----------
pdecon_2 = Deconstruct(Point=item_5)  # -> XComponent, YComponent, ZComponent
angle_sorter = GhPythonScript(angle=calc_angle_from_north.angle, X=pdecon_2.XComponent, Y=pdecon_2.YComponent)  # -> out, dir, key; inputs X: list, Y: list
# ---------- angle_sorter: Python ----------
__author__ = "jmccarty_teach"

import rhinoscriptsyntax as rs
if angle < 90:
    print("North, largest X")
    dir = "X"
    key = max(X)
elif 90 <= angle < 180:
    print("East, lowest Y")
    dir = "Y"
    key = min(Y)
elif 180 <= angle < 270:
    print("South, lowest X")
    dir = "X"
    key = min(X)
elif angle >= 270:
    print("West, largest Y")
    dir = "Y"
    key = max(Y)
# ---------- end angle_sorter ----------
python = GhPythonScript(dir=angle_sorter.dir, key=angle_sorter.key, x_list=pdecon_2.XComponent, y_list=pdecon_2.YComponent)  # -> out, out_dir, index; inputs x_list: list, y_list: list
# ---------- python: Python ----------
__author__ = "jmccarty_teach"

import rhinoscriptsyntax as rs

if dir=="X":
    out_dir = "X"
    index = x_list.index(key)
else:
    out_dir = "Y"
    index = y_list.index(key)
# ---------- end python ----------
item_6 = ListItem(List=item_5, Index=python.index, Wrap=True)

# ---- group: Obstructing Surfaces inside main surface
bbx = BrepBrep(BrepA=merge_6, BrepB=brep)  # -> Curves, Points
lng = ListLength(List=bbx.Curves)
larger_2 = LargerThan(FirstNumber=lng, SecondNumber=0)  # -> LargerThan, OrEqualTo
trim_3 = TrimTree(Tree=larger_2.LargerThan, Depth=1)
dispatch_9 = Dispatch(List=brep, DispatchPattern=trim_3)  # -> ListA, ListB

# ----
pt_lower_left = Point(item_6)

# ---- group: Dispatch Flat Roof
evalsrf_7 = EvaluateSurface(Surface=brep_2, Point=area_13.Centroid)  # -> Point, Normal, UDirection, VDirection, Frame
devec_4 = DeconstructVector(Vector=evalsrf_7.Normal)  # -> XComponent, YComponent, ZComponent
equalst = EqualityWithinTolerance(FirstNumber=devec_4.ZComponent, SecondNumber=Slider(1, range=-1..1), Tolerance=0.01)  # -> Equality, Inequality
dispatch_10 = Dispatch(List=brep_2, DispatchPattern=equalst.Equality)  # -> ListA, ListB
dispatch_11 = Dispatch(List=evalsrf_7.Normal, DispatchPattern=equalst.Equality)  # -> ListA, ListB
dispatch_12 = Dispatch(List=pt_lower_left, DispatchPattern=equalst.Equality)  # -> ListA, ListB
clean = CleanTree(RemoveNulls=True, RemoveInvalid=True, RemoveEmpty=True, Tree=dispatch_12.ListB)
clean_2 = CleanTree(RemoveNulls=True, RemoveInvalid=True, RemoveEmpty=True, Tree=dispatch_10.ListB)
clean_3 = CleanTree(RemoveNulls=True, RemoveInvalid=True, RemoveEmpty=True, Tree=dispatch_11.ListB)

# ---- group: Tilted Surface Planes
wires = BrepWireframe(Brep=clean_2, Density=-1)
trim_helper = TrimHelper(output_paths=wires, input_paths=clean)
midpt = CurveMiddle(Curve=trim_helper)
pdecon_3 = Deconstruct(Point=midpt)  # -> XComponent, YComponent, ZComponent
pdecon_4 = Deconstruct(Point=clean)  # -> XComponent, YComponent, ZComponent
equalst_2 = EqualityWithinTolerance(FirstNumber=pdecon_3.ZComponent, SecondNumber=pdecon_4.ZComponent, Tolerance=Slider(0.01, range=0..1.5))  # -> Equality, Inequality
dispatch_13 = Dispatch(List=midpt, DispatchPattern=equalst_2.Equality)  # -> ListA, ListB
pl = PlaneNormal(Origin=clean, ZAxis=clean_3)
vec2pt = Vector2Pt(PointA=clean, PointB=dispatch_13.ListA, Unitize=False)  # -> Vector, Length
align = AlignPlane(Plane=pl, Direction=vec2pt.Vector)  # -> Plane, Angle

# ---- group: Extend roof to clean up excess surface
evalsrf_8 = EvaluateSurface(Surface=merge_6, Point=area_12.Centroid)  # -> Point, Normal, UDirection, VDirection, Frame
amp_2 = Amplitude(Vector=evalsrf_8.Normal, Amplitude=15)
crv_2 = Curve(merge_6)
extr_2 = Extrude(Base=crv_2, Direction=amp_2)

# ---- group: Integrated Surfaces
panel_6 = Panel("output_integrated_surfaces")
srf_2 = Surface(item_3)

# ---- group: Flat Roof PLanes
clean_4 = CleanTree(RemoveNulls=True, RemoveInvalid=True, RemoveEmpty=True, Tree=dispatch_12.ListA)
clean_5 = CleanTree(RemoveNulls=True, RemoveInvalid=True, RemoveEmpty=True, Tree=dispatch_10.ListA)
wires_2 = BrepWireframe(Brep=clean_5, Density=-1)
pt = Point(clean_4)
trim_helper_2 = TrimHelper(output_paths=wires_2, input_paths=pt)

# ---- group: Flat Roof PLanes / Join boundary curves for each surface and find the outside curve by comparing the area of any curves in the set.
join_2 = JoinCurves(Curves=trim_helper_2, Preserve=False)

# ---- group: Flat Roof PLanes (continued)
area_14 = Area(Geometry=join_2)  # -> Area, Centroid

# ---- group: Flat Roof PLanes / Join boundary curves for each surface and find the outside curve by comparing the area of any curves in the set. (continued)
sort_3 = SortList(Keys=area_14.Area, ValuesA=join_2)  # -> Keys, reverse(ValuesA)
item_7 = ListItem(List=sort_3.ValuesA, Index=0, Wrap=True)
trim_helper_3 = TrimHelper(output_paths=item_7, input_paths=pt)

# ---- group: Flat Roof PLanes / generate curve to all segments from boundary origin. test if midpoint of new curve intersects with the boundary curve. use this to build initial plane.
midpt_2 = CurveMiddle(Curve=trim_helper_2)
ln_2 = Line(StartPoint=pt, EndPoint=midpt_2)
len_2 = Length(Curve=ln_2)
sort_4 = SortList(Keys=len_2, ValuesA=ln_2)  # -> Keys, ValuesA
midpt_3 = CurveMiddle(Curve=sort_4.ValuesA)
incurve = PointInCurve(Point=midpt_3, Curve=trim_helper_3)  # -> Relationship, Point
equals = Equality(FirstNumber=incurve.Relationship, SecondNumber=Slider(1, range=0..1))  # -> Equality, Inequality
dispatch_14 = Dispatch(List=midpt_3, DispatchPattern=equals.Equality)  # -> ListA, ListB
pt_2 = Point(dispatch_14.ListA)
split = SplitList(List=pt_2, Index=Slider(1, range=0..1))  # -> ListA, ListB
trim_helper_4 = TrimHelper(output_paths=split.ListB, input_paths=pt_2)
trim_helper_5 = TrimHelper(output_paths=split.ListA, input_paths=pt_2)
pl_3pt = Plane3Pt(PointA=pt, PointB=trim_helper_5, PointC=trim_helper_4)
deplane = DeconstructPlane(Plane=pl_3pt)  # -> Origin, XAxis, YAxis, ZAxis

# ---- group: Flat Roof PLanes / Create base XY plane and align. Test aligns to see which has X and Y vectors that lie on the surface boundary
xy = XYPlane(Origin=pt)
align_2 = AlignPlane(Plane=xy, Direction=deplane.XAxis)  # -> Plane, Angle
align_3 = AlignPlane(Plane=xy, Direction=deplane.YAxis)  # -> Plane, Angle
deplane_2 = DeconstructPlane(Plane=align_2.Plane)  # -> Origin, XAxis, YAxis, ZAxis
deplane_3 = DeconstructPlane(Plane=align_3.Plane)  # -> Origin, XAxis, YAxis, ZAxis
vdis = VectorDisplay(Anchor=pt, Vector=deplane_3.XAxis)
vdis_2 = VectorDisplay(Anchor=pt, Vector=deplane_3.YAxis)
number_slider_7 = Slider(0.1, range=0..0.1)
line_2 = LineSDL(Start=pt, Direction=deplane_2.XAxis, Length=number_slider_7)
line_3 = LineSDL(Start=pt, Direction=deplane_2.YAxis, Length=number_slider_7)
line_4 = LineSDL(Start=pt, Direction=deplane_3.XAxis, Length=number_slider_7)
line_5 = LineSDL(Start=pt, Direction=deplane_3.YAxis, Length=number_slider_7)
end = EndPoints(Curve=line_2)  # -> Start, End
end_2 = EndPoints(Curve=line_3)  # -> Start, End
end_3 = EndPoints(Curve=line_4)  # -> Start, End
end_4 = EndPoints(Curve=line_5)  # -> Start, End
incurve_2 = PointInCurve(Point=end_2.End, Curve=trim_helper_3)  # -> Relationship, Point
incurve_3 = PointInCurve(Point=end_4.End, Curve=trim_helper_3)  # -> Relationship, Point
incurve_4 = PointInCurve(Point=end_3.End, Curve=trim_helper_3)  # -> Relationship, Point
incurve_5 = PointInCurve(Point=end.End, Curve=trim_helper_3)  # -> Relationship, Point
addition = Addition(A=incurve_5.Relationship, B=incurve_2.Relationship)
number_slider_8 = Slider(2, range=0..10)
addition_2 = Addition(A=incurve_4.Relationship, B=incurve_3.Relationship)
equals_2 = Equality(FirstNumber=addition_2, SecondNumber=number_slider_8)  # -> Equality, Inequality
equals_3 = Equality(FirstNumber=addition, SecondNumber=number_slider_8)  # -> Equality, Inequality
dispatch_15 = Dispatch(List=align_2.Plane, DispatchPattern=equals_3.Equality)  # -> ListA, ListB
dispatch_16 = Dispatch(List=align_3.Plane, DispatchPattern=equals_2.Equality)  # -> ListA, ListB
merge_7 = Merge(Data1=dispatch_15.ListA, Data2=dispatch_16.ListA)

# ---- group: Planes
merge_8 = Merge(Data1=align.Plane, Data2=merge_7)

# ----
item_8 = ListItem(List=merge_8, Index=0, Wrap=True)

# ---- group: Determine origin point for contour operation
deplane_4 = DeconstructPlane(Plane=item_8)  # -> Origin, XAxis, YAxis, ZAxis
boolean_toggle = BooleanToggle(True)
boolean_toggle_2 = BooleanToggle(False)
line_6 = LineSDL(Start=deplane_4.Origin, Direction=deplane_4.YAxis, Length=1)
line_7 = LineSDL(Start=deplane_4.Origin, Direction=deplane_4.ZAxis, Length=1)
rotate_3d = Rotate3D(
    geometry=line_6,
    angle=primary_azimuth_max_90,
    clockwise=boolean_toggle_2,
    degree=boolean_toggle,
    center=deplane_4.Origin,
    axis=line_7)  # -> geometry_2, transform
rotate_3d_2 = Rotate3D(
    geometry=item_8,
    angle=primary_azimuth_max_90,
    clockwise=boolean_toggle_2,
    degree=boolean_toggle,
    center=deplane_4.Origin,
    axis=line_7)  # -> geometry_2, transform
end_5 = EndPoints(Curve=rotate_3d.geometry_2)  # -> Start, End
vec2pt_2 = Vector2Pt(PointA=end_5.Start, PointB=end_5.End, Unitize=Toggle(True))  # -> Vector, Length
bbox = BoundingBox(Content=merge_6, Plane=rotate_3d_2.geometry_2)  # -> simplify(Box), Box_2
pt_3 = Point(pt_lower_left)
debrep_7 = DeconstructBrep(Brep=bbox.Box)  # -> Faces, Edges, simplify(Vertices)
cset_2 = CreateSet(List=debrep_7.Vertices)  # -> Set, Map
vec2pt_3 = Vector2Pt(PointA=pt_lower_left, PointB=cset_2.Set, Unitize=Toggle(True))  # -> Vector, Length
vlen = VectorLength(Vector=vec2pt_3.Vector)
larger_3 = LargerThan(FirstNumber=vlen, SecondNumber=0)  # -> LargerThan, OrEqualTo
dispatch_17 = Dispatch(List=vec2pt_3.Vector, DispatchPattern=larger_3.LargerThan)  # -> ListA, ListB
angle = Angle(VectorA=vec2pt_2.Vector, VectorB=dispatch_17.ListA, Plane=item_8)  # -> Angle, Reflex
deg = Degrees(Radians=angle.Angle)
python_2 = GhPythonScript(x=deg)  # -> out, a
# ---------- python_2: Python ----------
__author__ = "jmccarty"

import rhinoscriptsyntax as rs
import math 
a = round(x,2)
# ---------- end python_2 ----------
equals_4 = Equality(FirstNumber=python_2.a, SecondNumber=90)  # -> Equality, Inequality
dispatch_18 = Dispatch(List=cset_2.Set, DispatchPattern=equals_4.Equality)  # -> ListA, ListB
pt_4 = Point(dispatch_18.ListA)
python_3 = GhPythonScript(x=primary_azimuth_max_90, og=pt_3, new=pt_4)  # -> out, a; inputs x: Int32, og: tree of Point3d, new: tree of Point3d
# ---------- python_3: Python ----------
__author__ = "jmccarty"

import rhinoscriptsyntax as rs

if x==0:
    a = og
elif x==90:
    a = og
else:
    a = new
# ---------- end python_3 ----------

# ---- group: Get bounding box face
area_15 = Area(Geometry=debrep_7.Faces)  # -> Area, Centroid
sort_5 = SortList(Keys=area_15.Area, ValuesA=debrep_7.Faces)  # -> Keys, reverse(ValuesA)
item_9 = ListItem(List=sort_5.ValuesA, Index=0, Wrap=True)

# ---- group: Main Contour
contour = Contour(Shape=item_9, Point=python_3.a, Direction=vec2pt_2.Vector, Distance=calculate_row_distance.d_contour)
trim_4 = TrimTree(Tree=contour, Depth=1)

# ----
amp_3 = Amplitude(Vector=vec2pt_2.Vector, Amplitude=calculate_row_distance.x_p)
move = Move(Geometry=trim_4, Motion=amp_3)  # -> Geometry, Transform

# ---- group: secondary lower rail
amp_4 = Amplitude(Vector=vec2pt_2.Vector, Amplitude=calculate_row_distance.x)
move_2 = Move(Geometry=trim_4, Motion=amp_4)  # -> Geometry, Transform
graft = GraftTree(Tree=move_2.Geometry, IncludeEmptyLists=True, IncludeNullItems=True)

# ---- group: primary_upper rail
amp_5 = Amplitude(Vector=deplane_4.ZAxis, Amplitude=calculate_row_distance.y_p)
move_3 = Move(Geometry=move.Geometry, Motion=amp_5)  # -> graft(Geometry), Transform

# ---- group: secondary upper rail
amp_6 = Amplitude(Vector=deplane_4.ZAxis, Amplitude=calculate_row_distance.y_s)
move_4 = Move(Geometry=move.Geometry, Motion=amp_6)  # -> graft(Geometry), Transform

# ---- group: primary lower rail
graft_2 = GraftTree(Tree=trim_4, IncludeEmptyLists=True, IncludeNullItems=True)

# ---- group: Module Surface
loft = Loft(
    Curves=[graft_2, move_3.Geometry],
    Options={Adjust=False, Closed=False, LoftEnds=0, LoftSimp=0, LoftType=0, Rebuild=10, Refit=0.01})
loft_2 = Loft(
    Curves=[graft, move_4.Geometry],
    Options={Adjust=False, Closed=False, LoftEnds=0, LoftSimp=0, LoftType=0, Rebuild=10, Refit=0.01})
trim_5 = TrimTree(Tree=loft, Depth=1)
trim_6 = TrimTree(Tree=loft_2, Depth=1)
merge_9 = Merge(Data1=trim_5, Data2=trim_6)  # -> simplify(Result)

# ---- group: Split Surfaces that extend beyond roof useable area
bbx_2 = BrepBrep(BrepA=simplify(extr_2), BrepB=merge_9)  # -> Curves, Points
srfsplit_2 = SurfaceSplit(Surface=graft(merge_9), Curves=bbx_2.Curves)
cap = CapHoles(Brep=extr_2)
trim_7 = TrimTree(Tree=srfsplit_2, Depth=2)

# ---- group: Modules with centers in main roof area
area_16 = Area(Geometry=trim_7)  # -> Area, Centroid
brepinc_3 = PointInBrep(Brep=cap, Point=area_16.Centroid, Strict=False)
dispatch_19 = Dispatch(List=trim_7, DispatchPattern=brepinc_3)  # -> ListA, ListB

# ---- group: Cut holes from obstructions like chimneys
brep_3 = Brep(dispatch_9.ListA)
crv_3 = Curve(brep_3)
extr_3 = Extrude(Base=crv_3, Direction=amp_2)
extr_4 = Extrude(Base=brep_3, Direction=amp_2)
bbx_3 = BrepBrep(BrepA=simplify(extr_3), BrepB=dispatch_19.ListA)  # -> Curves, Points
srfsplit_3 = SurfaceSplit(Surface=graft(dispatch_19.ListA), Curves=bbx_3.Curves)
cap_2 = CapHoles(Brep=extr_4)
trim_8 = TrimTree(Tree=srfsplit_3, Depth=2)
area_17 = Area(Geometry=trim_8)  # -> Area, Centroid
lng_2 = ListLength(List=trim_8)
repeat = RepeatData(Data=1, Length=lng_2)  # -> simplify(Data)
brepinc_4 = PointInBrep(Brep=cap_2, Point=area_17.Centroid, Strict=False)
subtraction = Subtraction(A=repeat, B=brepinc_4)
dispatch_20 = Dispatch(List=trim_8, DispatchPattern=subtraction)  # -> ListA, ListB
brep_4 = Brep(dispatch_20.ListA)

# ---- group: Clean Up Normals
area_18 = Area(Geometry=brep_4)  # -> Area, Centroid
evalsrf_9 = EvaluateSurface(Surface=brep_4, Point=area_18.Centroid)  # -> Point, Normal, UDirection, VDirection, Frame
devec_5 = DeconstructVector(Vector=evalsrf_9.Normal)  # -> XComponent, YComponent, ZComponent
smaller_3 = SmallerThan(FirstNumber=devec_5.ZComponent, SecondNumber=0)  # -> SmallerThan, OrEqualTo
dispatch_21 = Dispatch(List=brep_4, DispatchPattern=smaller_3.SmallerThan)  # -> ListA, ListB
flip_5 = Flip(Surface=dispatch_21.ListA)  # -> Surface, Result
panel_7 = Panel("output_raised_surfaces")
merge_10 = Merge(Data1=flip_5.Surface, Data2=dispatch_21.ListB)  # -> flatten(Result)

# ---- group: Gather Layers and Geometry
layer_geo_list = Relay([dispatch_2.ListB, dispatch_3.ListB])
lng_3 = ListLength(List=srf_2)
lng_4 = ListLength(List=redumsh.Reduced)
lng_5 = ListLength(List=merge_10)
lng_6 = ListLength(List=pipeline)
lng_7 = ListLength(List=redumsh_2.Reduced)
lng_8 = ListLength(List=merge)
lng_9 = ListLength(List=pipeline_2)
lng_10 = ListLength(List=layer_geo_list)
lng_11 = ListLength(List=merge_2)
repeat_2 = RepeatData(Data=panel_6, Length=lng_3)
repeat_3 = RepeatData(Data=panel_2, Length=lng_4)
repeat_4 = RepeatData(Data=panel_7, Length=lng_5)
repeat_5 = RepeatData(Data="output_host", Length=lng_6)
repeat_6 = RepeatData(Data=panel_3, Length=lng_7)
repeat_7 = RepeatData(Data="output_terrain", Length=lng_8)
repeat_8 = RepeatData(Data=panel, Length=lng_9)
repeat_9 = RepeatData(Data="output_host_obstructions", Length=lng_10)
repeat_10 = RepeatData(Data="output_host_windows", Length=lng_11)
layers = Entwine(
    Branch00=repeat_3,
    Branch01=repeat_6,
    Branch02=repeat_2,
    Branch03=repeat_4,
    Branch04=repeat_8,
    Branch05=repeat_7,
    Branch06=repeat_5,
    Branch07=repeat_9,
    Branch08=repeat_10,
    FlattenInputs=True)

# ---- group: Gather Layers and Geometry / Geometry
geoemtry = Entwine(
    Branch00=redumsh.Reduced,
    Branch01=redumsh_2.Reduced,
    Branch02=srf_2,
    Branch03=merge_10,
    Branch04=pipeline_2,
    Branch05=merge,
    Branch06=pipeline,
    Branch07=layer_geo_list,
    Branch08=merge_2,
    FlattenInputs=True)

# ----
pcexport3dm = Export3DM(
    Geometry=flatten(geoemtry),
    Layer=flatten(layers),
    FileLocation=name_geometry_file.out_file,
    Overwrite=True,
    Version=0,
    Export=write_overwrite_new_geometry_file,
    CopyAttributes=False,
    LastSaveLocalization="neutral,N",
    OverrideLayer=False,
    TreatGhGeoAsRef=True)  # -> OK, Log

# ==== cluster TrimHelper
output_paths = ClusterInput()
input_paths = ClusterInput()
pd = PathDescription(Output_paths=output_paths)  # -> flatten(Paths)
pd_2 = PathDescription(Input_paths=input_paths)  # -> flatten(Paths)
item = ListItem(List=pd_2, Index=0, Wrap=True)
item_2 = ListItem(List=pd, Index=0, Wrap=True)
trim_if_path_longer = GhPythonScript(input_path=item, output_path=item_2)  # -> out, trim_bool, trim_number
# ---------- trim_if_path_longer: Python ----------
__author__ = "jmccarty"

import rhinoscriptsyntax as rs

input_ = len(input_path.split(";"))
output_ = len(output_path.split(";"))

if input_==output_:
    trim_bool = False
    trim_number = 0
else:
    trim_bool = True
    trim_number = output_ - input_
# ---------- end trim_if_path_longer ----------
trim = TrimTree(Input_data=output_paths, Depth=trim_if_path_longer.trim_number)
data = ClusterOutput(trim)

# ==== cluster Rotate3D: Rotate an object around a center point and an axis vector.
geometry = ClusterInput()
angle = ClusterInput()  # Rotation Angle in Radians
clockwise = ClusterInput()  # Clockwise Rotation or Anticlockwise
degree = ClusterInput()  # Degree or Radian
center = ClusterInput()
axis = ClusterInput()
number = Number(flatten(angle))
negative = Negative(Value=number)
boolean = Boolean(clockwise)
boolean_2 = Boolean(degree)
number_2 = Number([negative, number])
list_item = ListItem(List=number_2, Index=boolean, Wrap=True)
radians = Radians(Degrees=list_item)
number_3 = Number([list_item, radians])
list_item_2 = ListItem(List=number_3, Index=boolean_2, Wrap=True)
rotate_3d = Rotate3D(Geometry=geometry, Angle=list_item_2, Center=center, Axis=axis)  # -> Geometry, Transform
transform = ClusterOutput(rotate_3d.Transform)
geometry_2 = ClusterOutput(rotate_3d.Geometry)
