# Grasshopper definition diffuse_direct_split_sims.gh (Grasshopper 1.0.7)
# plug-ins: MeshEdit Components, Pufferfish

number_slider = Slider(0.9, range=0..1)
panel = Panel("""mask_rows
mask_columns
rectangle
triangle
circle
ellipse
random_squares_small
random_squares_large
organic""")
item = ListItem(List=panel, Index=Slider(8, range=0..8), Wrap=True)
height = Slider(6.878, range=0..10)
width = Slider(19.11, range=0..100)
panel_2 = Panel("rectangle")
python = GhPythonScript(shape=item, coverage=number_slider)  # -> out, a, b
# ---------- python: Python ----------
import os

coverage_name = '%0.2f' % coverage
coverage_name = coverage_name.split(".")[-1]
dir = "/Users/jmccarty/Nextcloud/Projects/17_framework/notebooks/masks"
fname = "mask_"+shape+"_"+coverage_name+".jpg"
a = os.path.exists(os.path.join(dir,fname))
b = os.path.join(dir,fname)
# ---------- end python ----------
panel_3 = Panel(python.b)
python_2 = GhPythonScript(shape=item, coverage=number_slider)  # -> out, a, b; same code as python
# MODULE_DIMS = (982.5, 1592.5) # height, width
# SURFACE_DIMS = ((MODULE_DIMS[0]*7),(MODULE_DIMS[1]*12)) # 7 tall, 12 wide
path = FilePath("/Users/jmccarty/Desktop/tes.jpg")
pt = Point(Point(0, 0, 0))
X = UnitX(Factor=1)
panel_4 = Panel(python_2.a)
pt_2 = Point(Point(15.01877347, 60.15037594, 0))
pt_3 = Point(Point(785.9824781, 338.8471178, 0))
img = ImportImage(File=python.b)
python_3 = GhPythonScript(x=python.b)  # -> out, a
# ---------- python_3: Python ----------
__author__ = "jmccarty"

import rhinoscriptsyntax as rs

a = x.split("/")[-1].split(".")[0]
# ---------- end python_3 ----------
rec_2pt = Rectangle2Pt(Plane=PlaneXY(0, 0, 0), PointA=pt_2, PointB=pt_3, Radius=0)  # -> Rectangle, Length
panel_5 = Panel(rec_2pt.Rectangle)
python_4 = GhPythonScript(x=panel_5, actual_height=height, actual_width=width)  # -> out, a
# ---------- python_4: Python ----------
__author__ = "jmccarty"

import rhinoscriptsyntax as rs

dims = x.strip("Rectangle ").split(",")
w = float(dims[0].strip("(w="))
h = float(dims[1].strip(" h=").strip(")"))

height_ratio = h / actual_height
width_ratio = w / actual_width

scale_factor = (height_ratio + width_ratio) / 2
a = 1/scale_factor
# ---------- end python_4 ----------
facen = FaceNormals(Mesh=img)  # -> Centers, Normals
incurve = PointInCurve(Point=facen.Centers, Curve=rec_2pt.Rectangle)  # -> Relationship, Point
cullf = CullFaces(Mesh=img, Pattern=invert(incurve.Relationship))
meshcp = MeshClosestPoint(Point=graft(incurve.Point), Mesh=cullf)  # -> Point, Index, Parameter
meval = MeshEval(Mesh=cullf, Parameter=meshcp.Parameter)  # -> Point, Normal, flatten(Colour)
cset = CreateSet(List=meval.Colour)  # -> Set, Map
split = TextSplit(Text=meval.Colour, Separators=",")
item_2 = ListItem(List=split, Index=0, Wrap=True)  # -> flatten(Item)
larger = LargerThan(FirstNumber=item_2, SecondNumber=Slider(200, range=0..1000))  # -> LargerThan, OrEqualTo
dispatch = Dispatch(List=flatten(meshcp.Index), DispatchPattern=larger.LargerThan)  # -> ListA, ListB
explode = MeshExplode(Mesh=cullf, Interpolate=False)
number_slider_2 = Slider(90, range=0..1000)
number_slider_3 = Slider(2, range=0..10)
item_3 = ListItem(List=explode, Index=dispatch.ListB, Wrap=True)
rot3d = Rotate3D(Geometry=rec_2pt.Rectangle, Angle=degrees(number_slider_2), Center=pt_2, Axis=X)  # -> Geometry, Transform
faceb = FaceBoundaries(Mesh=item_3)
srf = Surface(faceb)
flip = Flip(Surface=srf)  # -> Surface, Result
multiplication = Multiplication()
path_2 = FilePath("/Users/jmccarty/Nextcloud/Projects/17_framework/cactus_framework_study/inputs/shared/tmy/base.epw")
group = Group(Objects=flatten(flip.Surface))
rot3d_2 = Rotate3D(Geometry=group, Angle=degrees(number_slider_2), Center=pt_2, Axis=X)  # -> Geometry, Transform
rot3d_3 = Rotate3D(Geometry=rot3d.Geometry, Angle=degrees(number_slider_2), Center=pt_2, Axis=X)  # -> Geometry, Transform
wea = HBWeaFromEPW(epw_file=path_2)  # -> wea; plug-in component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
importepw = LBImportEPW(epw_file=path_2)  # -> location, dry_bulb_temperature, dew_point_temperature, relative_humidity, wind_speed, wind_direction, direct_normal_rad, diffuse_horizontal_rad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; plug-in component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
srf_2 = Surface(rot3d.Geometry)
srf_3 = Surface(rot3d_3.Geometry)
flip_2 = Flip(Surface=srf_3)  # -> Surface, Result
area = Area(Geometry=srf_2)  # -> Area, Centroid
area_2 = Area(Geometry=flip_2.Surface)  # -> Area, Centroid
evalsrf = EvaluateSurface(Surface=srf_2, Point=area.Centroid)  # -> Point, Normal, UDirection, VDirection, Frame
evalsrf_2 = EvaluateSurface(Surface=flip_2.Surface, Point=area_2.Centroid)  # -> Point, Normal, UDirection, VDirection, Frame
number_slider_4 = Slider(6, range=1..12)
number_slider_5 = Slider(12, range=0..23)
number_slider_6 = Slider(30, range=1..31)
customsky = HBCustomSky(
    location=importepw.location,
    dir_rad=Slider(1000, range=0..1000),
    diff_rad=Slider(0, range=0..100),
    month=number_slider_4,
    day=number_slider_6,
    hour=number_slider_5)  # -> sky; plug-in component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
climatebased = HBClimatebasedSky(wea=wea, month=number_slider_4, day=number_slider_6, hour=number_slider_5)  # -> sky; plug-in component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
panel_6 = Panel(climatebased)
vdis = VectorDisplay(Anchor=area.Centroid, Vector=evalsrf.Normal)
vdis_2 = VectorDisplay(Anchor=area_2.Centroid, Vector=evalsrf_2.Normal)
ungroup = Ungroup(Group=rot3d_2.Geometry)
number_slider_7 = Slider(65, range=0..100)
srf_4 = Surface(srf_2)
srf_5 = Surface(srf_3)
srf_6 = Surface(ungroup)
hoy = LBCalculateHOY(month=number_slider_4, day=number_slider_6, hour=number_slider_5)  # -> flatten(hoy), flatten(doy), flatten(date); plug-in component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
wea_2 = HBWeaFromEPW(epw_file=path_2, hoys=hoy.hoy)  # -> wea; plug-in component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
number_slider_8 = Slider(0.5, range=0..1)
Y = UnitY(Factor=1)
scale_nu = ScaleNU(Geometry=srf_5, Plane=pt, ScaleX=python_4.a, ScaleY=python_4.a, ScaleZ=python_4.a)  # -> Geometry, Transform
amp = Amplitude(Vector=Y, Amplitude=expr("x*-1", number_slider_8))
scale_nu_2 = ScaleNU(Geometry=srf_4, Plane=pt, ScaleX=python_4.a, ScaleY=python_4.a, ScaleZ=python_4.a)  # -> Geometry, Transform
scale_nu_3 = ScaleNU(Geometry=srf_6, Plane=pt, ScaleX=python_4.a, ScaleY=python_4.a, ScaleZ=python_4.a)  # -> Geometry, Transform
group_2 = Group(Objects=scale_nu_3.Geometry)
move = Move(Geometry=group_2, Motion=amp)  # -> Geometry, Transform
python_5 = GhPythonScript(x=climatebased)  # -> out, a
# ---------- python_5: Python ----------
__author__ = "jmccarty"

import rhinoscriptsyntax as rs

a = x.split("-alt")[-1].split(" ")[1]
# ---------- end python_5 ----------
number_slider_9 = Slider(0.3, range=0..1)
tan = Tangent(Value=degrees(python_5.a))
searchmods = HBSearchMofidiers(keywords="generic_context_0.20")  # -> modifiers; plug-in component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
multiplication_2 = Multiplication(A=tan, B=number_slider_8)
Z = UnitZ(Factor=1)
genpts = LBGeneratePointGrid(geometry=scale_nu_2.Geometry, grid_size=Slider(0.5, range=0..2), offset_dist=Slider(0.05, range=0..0.1))  # -> points, vectors, face_areas, mesh; plug-in component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
face = HBFace(geo=[scale_nu.Geometry, scale_nu_2.Geometry], rad_mod=searchmods)  # -> report, faces; plug-in component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
amp_2 = Amplitude(Vector=Z, Amplitude=multiplication_2)
move_2 = Move(Geometry=move.Geometry, Motion=amp_2)  # -> Geometry, Transform
relay = Relay()
item_4 = ListItem(List=scale_nu_3.Geometry, Index=0, Wrap=True)
sensorgrid = HBSensorGrid(positions=genpts.points, directions=genpts.vectors, mesh=genpts.mesh)  # -> grid; plug-in component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
ungroup_2 = Ungroup(Group=move_2.Geometry)
mjoin = MeshJoin(Meshes=ungroup_2)
explode_2 = MeshExplode(Mesh=mjoin, Interpolate=False)
model = HBModel(faces=flatten([relay, face.faces]))  # -> report, model; plug-in component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
area_3 = Area(Geometry=scale_nu_3.Geometry)  # -> Area, graft(Centroid)
lng = ListLength(List=explode_2)
path_3 = FilePath("/Users/jmccarty/Desktop/test_mask/")
listdexs = ListIndices(List=genpts.points)
python_6 = GhPythonScript(shade_scenario=python_3.a)  # -> out, a
# ---------- python_6: Python ----------
import os

base_dir = "/Users/jmccarty/Nextcloud/Projects/17_framework/grasshopper/models"
save_dir = os.path.join(base_dir,shade_scenario)
if os.path.exists(save_dir):
    pass
else:
    os.mkdir(save_dir)
a = save_dir
# ---------- end python_6 ----------
multiplication_3 = Multiplication(A=lng, B=Slider(0.1, range=0..1))
cp = ClosestPoint(Point=area_3.Centroid, Cloud=genpts.points)  # -> ClosestPoint, flatten(CPIndex), Distance
radpar = HBRadianceParameter(recipe_type=Slider(2, range=0..2), detail_level=Slider(2, range=0..2))  # -> rad_par; plug-in component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
number_slider_10 = Slider(1, range=0..2)
recipesettings = HBRecipeSettings(folder=path_3, reload_old=False)  # -> settings; plug-in component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
cset_2 = CreateSet(List=cp.CPIndex)  # -> Set, Map
redumsh = ReduceMesh(Mesh=mjoin, FaceCount=multiplication_3, Accuracy=1, FaceType=0, Distort=True, Normalize=False)  # -> Reduced, CountDifference
panel_7 = Panel(radpar)
difference = SetDifference(SetA=listdexs, SetB=cset_2.Set)
assigngridsviews = HBAssignGridsAndViews(model=model.model, grids=flatten(sensorgrid))  # -> model; plug-in component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
flip_3 = MeshFlip(Mesh=redumsh.Reduced)
face_2 = HBFace(geo=flip_3, rad_mod=searchmods)  # -> report, faces; plug-in component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
path_4 = FilePath("/Users/jmccarty/Nextcloud/Projects/17_framework/grasshopper/baseline/")
ushaded = ListItem(List=genpts.points, Index=difference, Wrap=True)
item_5 = ListItem(List=genpts.points, Index=cset_2.Set, Wrap=True)
modeltorad = HBModelToRadFolder(model=assigngridsviews, folder=path_4, write=Toggle(False))  # -> report, folder; plug-in component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
ar = HBAmbientResolution(model=assigngridsviews, detail_dim=Slider(0.025, range=0..0.1), aa=Slider(0.1, range=0..0.1))  # -> ar; disabled; plug-in component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
annualirradiance = HBAnnualIrradiance(model=assigngridsviews, wea=wea_2, radiance_par=radpar, run_settings=recipesettings, run=Toggle(False))  # -> report, results, res_direct, avg_irr, peak_irr, radiation; plug-in component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
annualtodata = HBAnnualResultsToData(
    results=flatten(annualirradiance.results),
    sel_pts=flatten(genpts.points),
    all_pts=genpts.points,
    sel_vecs=flatten(genpts.vectors),
    all_vecs=genpts.vectors)  # -> report, data; plug-in component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
annualtodata_2 = HBAnnualResultsToData(
    results=flatten(annualirradiance.res_direct),
    sel_pts=flatten(genpts.points),
    all_pts=genpts.points,
    sel_vecs=flatten(genpts.vectors),
    all_vecs=genpts.vectors)  # -> report, data; plug-in component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
analysisperiod = LBAnalysisPeriod(
    start_month=number_slider_4,
    start_day=number_slider_6,
    start_hour=number_slider_5,
    end_month=number_slider_4,
    end_day=number_slider_6,
    end_hour=number_slider_5)  # -> period, hoys, dates; plug-in component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
subtraction = Subtraction(A=hoy.hoy, B=1)
number_slider_11 = Slider(200, range=0..1000)
xdata = LBDeconstructData(data=annualtodata.data)  # -> header, values; plug-in component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
addition = Addition(A=analysisperiod.hoys, B=1)
xdata_2 = LBDeconstructData(data=annualtodata_2.data)  # -> header, values; plug-in component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
branch = TreeBranch(Tree=simplify(xdata_2.values), Path=number_slider_11, MaintainPaths=True)
branch_2 = TreeBranch(Tree=simplify(xdata.values), Path=number_slider_11, MaintainPaths=True)
listdexs_2 = ListIndices(List=branch_2)
listdexs_3 = ListIndices(List=branch)
sort = SortList(Keys=branch_2, ValuesA=listdexs_2)  # -> reverse(Keys), reverse(ValuesA)
sort_2 = SortList(Keys=branch, ValuesA=listdexs_3)  # -> reverse(Keys), reverse(ValuesA)
item_6 = ListItem(List=sort.ValuesA, Index=0, Wrap=True)
item_7 = ListItem(List=sort.ValuesA, Index=0, Wrap=True)

# ---- group: Total
item_8 = ListItem(List=xdata.values, Index=item_6, Wrap=True)  # -> flatten(Item)

# ----
panel_8 = Panel(item_8)

# ---- group: Direct
item_9 = ListItem(List=xdata_2.values, Index=item_7, Wrap=True)  # -> flatten(Item)

# ---- group: Diffuse
subtraction_2 = Subtraction(A=item_8, B=item_9)

# ----
python_7 = GhPythonScript(x=subtraction_2)  # -> out, a; inputs x: list
# ---------- python_7: Python ----------
__author__ = "jmccarty"

import rhinoscriptsyntax as rs
a = []
for n in x:
    if n<0:
        n=0
    a.append(n)
# ---------- end python_7 ----------
legendpar = LBLegendParameters(min=Slider(0, range=0..100))  # -> leg_par; plug-in component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
sort_3 = SortList(Keys=subtraction_2)  # -> Keys, ValuesA
division = Division(A=python_7.a, B=item_8)
item_10 = ListItem(List=division, Index=cset_2.Set, Wrap=True)
graph = QuickGraph(sort_3.Keys, SortOrder=0)
heatmap = LBSpatialHeatmap(values=subtraction_2, mesh=genpts.mesh, legend_par=legendpar, legend_title="Ratio", global_title="Diffuse / Total")  # -> mesh, legend, title, colors, legend_par, vis_set; plug-in component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
avr = Average(Input=item_10)
python_8 = GhPythonScript(x=python.b)  # -> out, a; same code as python_3
concat = Concatenate(FragmentA=python_8.a, FragmentC="_", FragmentB=avr)
rec = DataRecorder(concat, DataLimit=-10, RecordData=True)
panel_9 = Panel(rec)
